# Grasshopper definition basemap.gh (Grasshopper 1.0.7)
# plug-ins: Human

layertable = LayerTable(Update=Button(), AutoUpdate=False)  # -> Layers, FullLayerPaths, LayerColors, Linetypes, MaterialNames, Visible, PrintWidth, PrintColor
difference = SetDifference(SetA=layertable.FullLayerPaths, SetB=layertable.Layers)
difference_2 = SetDifference(SetA=layertable.Layers, SetB=layertable.FullLayerPaths)
sort = SortList(Keys=difference_2, ValuesA=difference)  # -> Keys, ValuesA
panel = Panel(sort.ValuesA)
dpipeline = DynamicGeometryPipeline(
    LayerFilter=panel,
    TypeFilter="Brep",
    NameFilter="*",
    GroupByLayer=False,
    GroupByType=False,
    IncludeHidden=True,
    IncludeLocked=True,
    enableFullPath=True,
    listenToAttributes=True)
srf = Surface(dpipeline)
srf_2 = Surface(<surface referenced from the Rhino model>)  # disabled
bbox = BoundingBox(Content=srf, Plane=PlaneXY(0, 0, 0))  # -> Box, Box_2
bbox_2 = BoundingBox(Content=srf, Plane=PlaneXY(0, 0, 0))  # -> Box, Box_2
debox = DeconstructBox(Box=bbox.Box)  # -> Plane, X, Y, Z
merge = Merge(Data1=debox.X, Data2=debox.Y)
dedomain = DeconstructDomain(Domain=merge)  # -> Start, End
debox_2 = DeconstructBox(Box=bbox_2.Box)  # -> Plane, X, Y, Z
merge_2 = Merge(Data1=dedomain.Start, Data2=dedomain.End)
merge_3 = Merge(Data1=debox_2.Y, Data2=debox_2.X)
join = TextJoin(Text=merge_2, Join=",")  # -> flatten(Result)
dedomain_2 = DeconstructDomain(Domain=merge_3)  # -> Start, End
concat = Concatenate(FragmentA="[", FragmentB=join, FragmentC="]")
txt = Text(sort.Keys)
join_2 = TextJoin(Text=dedomain_2.Start, Join=",")
join_3 = TextJoin(Text=dedomain_2.End, Join=",")
merge_4 = Merge(Data1=simplify(graft(txt)), Data2=simplify(graft(concat)))
panel_2 = Panel("""id
extent""")
concat_2 = Concatenate(FragmentA="\"southwest\": [", FragmentB=join_2, FragmentC="],")
concat_3 = Concatenate(FragmentA="\"northeast\": [", FragmentB=join_3, FragmentC="]")
join_4 = TextJoin(Text=panel_2, Join=";")  # -> flatten(Result)
join_5 = TextJoin(Text=merge_4, Join=";")  # -> flatten(Result)
join_6 = TextJoin(Text=[concat_2, concat_3])  # -> flatten(Result)
ins = InsertItems(List=join_5, Item=join_4, Indices="0", Wrap=True)

# ----
# for webmap -> data.json
panel_3 = Panel(join_6)

# ----
# pairs.csv
panel_4 = Panel(ins)

item = ListItem(List=join_6, Index=Slider(7, range=0..10), Wrap=True)
panel_5 = Panel(item)
